% Simulink data dictionary HPP18_DD.sldd

Diesel_Viscocity = Simulink.Parameter(875)
Discharge_Coefficient = Simulink.Parameter(0.7)
Divide_Constant = Simulink.Parameter(4)
Fuel_ConsumptionConversionToSec = Simulink.Parameter(1000)
IMV_Current = Simulink.Parameter(1.3)
Orifices_Dia = Simulink.Parameter(0.0035)
Pressure_UnitConversion = Simulink.Parameter(200000)
Time_ScalingFactor = Simulink.Parameter(1000)
meterToliter = Simulink.Parameter(1000)
Area_Of_Orifices = Simulink.Signal()
FlowRate_Of_Fuel = Simulink.Signal(DataType="single")
Fuel_Consumption = Simulink.Signal()
IMV_Time = Simulink.Signal(DataType="single")
LPP_Pressure = Simulink.Signal()
PCV_Sensor = Simulink.Signal(DataType="single")
Velocity_Of_Fuel = Simulink.Signal()
IMV_Time1 = Simulink.Signal(DataType="single")